vi "ldpcDecoding.gvi"   [LabVIEW NXG]
inputs:
  "ReceivedMessage": i32[]
  "CheckMatrixLocation": path
  "itMax": i32
outputs:
  "MesageDecoded": i32[]
panel controls:
  "WaitBetweenIteration": bool
panel indicators:
  "Syndrom": f64[]
  "loop iteration": i32
  "Variable: indicator": f64[]
  "Variable: out": i32[]
  "CheckMatrix": f64[][]
diagram:
  call "Read from Spreadsheet File (DBL).gvi"(file path=$CheckMatrixLocation, format="%.3f", delimiter=",") -> (all rows=w1)
  $CheckMatrix <- w1
  s1 = $ReceivedMessage  # shift register
  s2 = w1  # shift register
  while (iteration -> i1) {
    call "A x Vector.gvi"(A=s2, Vector=s1) -> (A x Vector=w2)
    Quotient And Remainder(x=w2, y=2) -> (x-y*floor(x/y)=w3)
    $Syndrom <- w3
    Math Node("syndrom"=w3, "H"=s2, "in"=s1) -> ("out"=w4, "indicator"=w5)
    ~~~
    count=0;

    m=size(H,1);    % Number of checks
    n=size(H,2);    % Number of bits in codeword
    k=n-m;


        % Find the checks that are not respected
        syndrom;

        % For each bit count the number of checks respected and not respected
        res=zeros(1,n);
        notRes=zeros(1,n);

        indicator=[m n size(H) size(syndrom) syndrom(1) syndrom(2) syndrom(3)];
        for bit=1:n
            for check=1:m
                if H(check, bit)==1
                    if syndrom(1, check)==1
                        notRes(bit)=notRes(bit)+1;
                    else
                        res(bit)=res(bit)+1;
                    end
                end
            end
        end

        % if more not respected flip the bit
        for bit=1:n
            if notRes(bit)>res(bit)
                in(bit)=mod(in(bit)+1,2);
            end
        end
        out=in;
    ~~~
    $"Variable: out" <- w4
    $"Variable: indicator" <- w5
    case ($WaitBetweenIteration) {
      frame False, Default { }
      frame True {
        Wait Ms(msToWait=1500)
      }
    }
    $"loop iteration" <- i1
    Add Array Elements(numeric array=w3) -> (sum=w6)
    Is Equal To 0(x=w6) -> w7
    Is Greater(x=i1, y=$itMax) -> w8
    Logical Or(w8, w7) -> w9
    next s1 = w4
    stop if w9
  }
  Array Size(array=w1) -> (size(s)=w10)
  Array Index(array=w10) -> (out0[1]=w11)
  Array Index(array=w10) -> (out0[0]=w12)
  Subtract(x=w11, y=w12) -> w13
  Array Subset(array=s1, length0=w13) -> w14
  $MesageDecoded <- w14
