vi "ldpcTest.gvi"   [LabVIEW NXG]
panel controls:
  "Noise": f64[]
  "CheckMatrixLocation": path
  "Message": i32[]
  "GeneratorMatrixLocation": path
  "stop": bool
panel indicators:
  "MesageDecoded": i32[]
diagram:
  while {
    call "ldpcCoding.gvi"(Message=$Message, GeneratorMatrixLocation=$GeneratorMatrixLocation) -> (CodedMessage=w1)
    Add($Noise, w1) -> w2
    Quotient And Remainder(x=w2, y=2) -> (x-y*floor(x/y)=w3)
    call "ldpcDecoding.gvi"(ReceivedMessage=w3, CheckMatrixLocation=$CheckMatrixLocation) -> (MesageDecoded=w4)
    $MesageDecoded <- w4
    stop if $stop
  }
