vi "Tx_main.gvi"   [LabVIEW NXG]
panel controls:
  "IQ_Rate": f64 = 500000
  "f0": f64 = 2450000000
  "Gain": f64 = 10
  "modulation type": T1 = "PSK"
  "PSK type": enum{"normal", "shifted", "offset"} = "normal"
  "samples per symbol": i32 = 16
  "pulse shaping filter": T2 = "Root Raised Cos"
  "filter parameter": f64 = 0.5
  "filter length": i32 = 8
  "stopRecoringSound": bool
  "stopDataEnqueing": bool
  "stopSendingData": bool
  "SamplesPerChannel": i32 = 128
  "multiple": f64 = 1000
  "correction": f64 = 0.02
  "bitsPerSample": i32 = 8
  "uLaw": bool
panel indicators:
  "data": waveform<f64>[]
  "PacketGraph": cluster{"t0": f64, "dt": f64, "Y": c128[]}
  "IQ Graph": T3[]
  "numOfElementInRadioQueue2": i32
  "numOfElementInSoundQueue": i32
  "numOfElementInSoundQueue2": i32
  "numOfElementInRadioQueue": i32
types:
  T1 = enum{"FSK", "PSK", "QAM", "MSK", "PAM", "ASK", "CPM"}
  T2 = enum{"none", "Raised Cosine", "Root Raised Cos", "Gaussian"}
  T3 = cluster{"constellation": f64[], "oversampled data": f64[]}
  T4 = cluster{"sample rate": f64, "number of channels": i32, "bits per sample": i32}
diagram:
  w1 = $SamplesPerChannel
  w2 = $bitsPerSample
  w3 = $correction
  w4 = $multiple
  Obtain Queue(element data type=i8[] [], max queue size (-1, unlimited)=2000, name (unnamed)="sound_bit_stream") -> (error out=w5, queue out=w6)
  w7 = T4 {"sample rate"=6000, "number of channels"=1, "bits per sample"=16}
  call "Sound Input Configure.gvi"(device ID=0, sound format=w7, sample mode=1, number of samples per channel=8000) -> (task ID=w8, error out=w9)
  call "Sound Input Start.gvi"(task ID=w8, error in=w9) -> (task ID out=w10, error out=w11)
  while {
    Multiply(w1, w2) -> w12
    call "Sound Input Read.gvi"(task ID=w10, error in=w11, number of samples per channel=w1, timeout=-1) -> (task ID out=w13, data=w14, error out=w15)
    for {
      w16 = each element of w14
      Property Node(instance in=w16) -> ("Y"=w17)
    }
    call "shiftAndMultSoundArray.gvi"(soundArray_raw=w17, correction=w3, multiply=w4) -> (processedSoundArray=w18)
    case ($uLaw) {
      frame False, Default {
        To Unsigned Byte Integer(number=w18) -> w19
      }
      frame True {
        call "uLawCodeArray16to8.gvi"(X=w18) -> (Y=w19)
      }
    }
    call "intArray2BitStream.gvi"(unsigned 8-bit integer=w19) -> (array=w20)
    Reshape Array(inArray=w20, size=w12) -> w21
    call "createPacket.gvi"(dataBitStream=w21) -> (packet=w22)
    Get Queue Status(error in (no error)=w5, queue=w6) -> (# elements in queue=w23, error out=w24, queue out=w25)
    Lossy Enqueue Element(element=w22, error in (no error)=w24, queue=w25)
    $data <- w14
    $numOfElementInSoundQueue <- w23
    stop if $stopRecoringSound
  }
  call "Sound Input Stop.gvi"(task ID=w13, error in=w15) -> (task ID out=w26, error out=w27)
  call "Sound Input Clear.gvi"(task ID=w26, error in=w27)
  w28 = $"samples per symbol"
  w29 = $"PSK type"
  w30 = $"modulation type"
  w31 = $"pulse shaping filter"
  w32 = $"filter parameter"
  w33 = $"filter length"
  w34 = cluster{"t0": f64, "dt": f64, "Y": c128[]} {"t0"=0, "dt"=1, "Y"=[]}
  Obtain Queue(element data type=w34, max queue size (-1, unlimited)=5000, name (unnamed)="enqueDataForRadio") -> (error out=w35, queue out=w36)
  call "niUSRP Open Tx Session.gvi"(Device names="192.168.10.2", Reset=TRUE) -> (Error Out=w37, Session handle=w38)
  call "niUSRP Configure Signal.gvi"(session handle=w38, IQ rate=$IQ_Rate, carrier frequency=$f0, gain=$Gain, error in (no error)=w37, active antenna="TX1") -> (session handle out=w39, coerced IQ rate=w40)
  while {
    Get Queue Status(error in (no error)=w5, queue=w6) -> (# elements in queue=w41, error out=w42, queue out=w43)
    Dequeue Element(error in (no error)=w42, queue=w43) -> (element=w44, error out=w45, queue out=w46)
    call "modulation_block.gvi"(modulation type=w30, PSK type=w29, pulse shaping filter=w31, filter parameter=w32, filter length=w33, input bit stream=w44, samples per symbol=w28, IQ_Rate=w40) -> (modulated_complex_waveform=w47)
    Get Queue Status(error in (no error)=w45, queue=w36) -> (# elements in queue=w48, error out=w49, queue out=w50)
    Lossy Enqueue Element(element=w47, error in (no error)=w49, queue=w50)
    $numOfElementInSoundQueue2 <- w41
    $numOfElementInRadioQueue <- w48
    stop if $stopDataEnqueing
  }
  Flush Queue(queue=w46) -> (queue out=w51)
  Release Queue(queue=w51)
  while {
    Get Queue Status(error in (no error)=w35, queue=w36) -> (# elements in queue=w52, error out=w53, queue out=w54)
    Dequeue Element(error in (no error)=w53, queue=w54) -> (element=w55, queue out=w56)
    call "addPadding.gvi"(dataIn=w55) -> (paddedDataOut=w57)
    call "niUSRP Write Tx Data (CDB Cluster).gvi"(session handle=w39, data=w57, end of data?=$stopSendingData) -> (session handle out=w58, Error Out=w59)
    $PacketGraph <- w57
    call "MT Format Constellation.gvi"(waveform=w57) -> (constellation graph=w60)
    $"IQ Graph" <- w60
    $numOfElementInRadioQueue2 <- w52
    stop if $stopSendingData
  }
  Flush Queue(queue=w56) -> (queue out=w61)
  Release Queue(queue=w61)
  call "niUSRP Close Session.gvi"(Handle in=w58, error in (no error)=w59)
